# Grasshopper definition builder_test.gh (Grasshopper 1.0.8)
# plug-ins: ComputeBuilder

num_nu = GetNumber(Slider(13, range=0..20), AtLeast=1, AtMost=1, Maximum=100, Minimum=10, TreeAccess=False)
get_string = GetString("fgdffgdfg", AtLeast=1, AtMost=1, TreeAccess=False)
value_list = ValueList({"One": 1, "Two": 2, "Three": 2² - 1, "Four": Sqrt(16)}, selected="One")
multiplication = Multiplication(A=num_nu, B=Slider(2, range=0..10))
get_value_list = GetValueList(
    value_list,
    AtLeast=1,
    AtMost=1,
    DefaultSelectedIndex=0,
    Immediate=True,
    StoredItems="""[
  {
    "name": "One",
    "expression": "1"
  },
  {
    "name": "Two",
    "expression": "2"
  },
  {
    "name": "Three",
    "expression": "2² - 1"
  },
  {
    "name": "Four",
    "expression": "Sqrt(16)"
  }
]""",
    TreeAccess=False)
sphere = Sphere(Base=PlaneXY(0, 0, 0), Radius=num_nu)
unit_x = UnitX(Factor=multiplication)
ui_builder = UIBuilder(
    Enable=Toggle(True),
    Refresh=Button(),
    OpenPreview=Toggle(True),
    Schema="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",
    SessionId="55a02125",
    Values="{\"3a1707e3-f116-4442-8a8d-d66777808bd4\":\"erwerwerwe\",\"12e4b4b9-2767-426b-baa5-0a0e1bcd0a5b\":38,\"8426f660-a18e-44bf-8529-89e5a32fd753\":\"Four\"}")  # -> SessionID, Info, Schema
panel = Panel(get_string)
panel_2 = Panel(num_nu)
number = Number(num_nu)
panel_3 = Panel(get_value_list)
linear_array = LinearArray(Geometry=sphere, Direction=unit_x, Count="40")  # -> Geometry, Transform
addition = Addition(A=number, B=Slider(100, range=0..1000))
schema = ContextPrint(Schema=ui_builder.Schema)
three_material = ThreeMaterial(Color=RGB(255, 255, 255), Metalness=0, Roughness=0.5, Opacity=1, Transparent=False)
context_print = ContextPrint(Text=addition)
display = Display(Geo=linear_array.Geometry, ThreeMaterial=three_material)
context_bake = ContextBake(Content=display)
