# Grasshopper definition builder_test.gh (Grasshopper 1.0.8)
# plug-ins: ComputeBuilder

number_slider = Slider(7, range=0..20)
number_slider_2 = Slider(10, range=0..100)
get_number_2 = GetNumber(number_slider, AtLeast=1, AtMost=1, Maximum=100, Minimum=10, TreeAccess=False)
get_number = GetNumber(number_slider, AtLeast=1, AtMost=1, Maximum=100, Minimum=10, TreeAccess=False)
get_string = GetString("fgdffgdfg", AtLeast=1, AtMost=1, TreeAccess=False)
get_boolean = GetBoolean(AtLeast=1, AtMost=1, FalseValue="False", TreeAccess=False, TrueValue="True")
get_integer = GetInteger(AtLeast=1, AtMost=1, Maximum=2147483647, Minimum=-2147483648, TreeAccess=False)
panel = Panel(get_number)
ui_builder = UIBuilder(Enable=Toggle(True), Refresh=Button(), Schema="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", SessionId="fb7e700e")  # -> SessionID, Info, Schema
panel_2 = Panel(get_string)
panel_3 = Panel(get_boolean)
panel_4 = Panel(get_integer)
number = Number(get_number)
clear_context_data = ClearContextData(SessionID=ui_builder.SessionID, Clear=Button())
addition = Addition(A=number, B=Slider(100, range=0..1000))
fgdf = ContextPrint(NumberOutput=addition)
context_print = ContextPrint()
